vi "Sample Rate Example.gvi"   [LabVIEW NXG 2.0.0]
panel controls:
  "stop": bool
  "Analog Input Frequency (Hz)": f64 = 1000
  "Analog Output Frequency (Hz)": f64 = 1000
  "Analog input channel": "DAQmx Physical Channel" = "cDAQ1Mod8/ai2"  # physical channels specifies the names of the physical channels to use to create virtual channels. The DAQmx physical channel constant lists all physical channels on devices and modules installed in the system.
  "Analog output channel": "DAQmx Physical Channel" = "cDAQ1Mod4/ao2"  # physical channels specifies the names of the physical channels to use to create virtual channels. The DAQmx physical channel constant lists all physical channels on devices and modules installed in the system.
panel indicators:
  "Time Domain Data": waveform<f64>
  "Frequency Domain Data": T1
  "Output SineWave": f64[]
  "Analog Output Frequency (Hz)_2": f64
types:
  T1 = cluster{"f0": f64, "df": f64, "magnitude": f64[]}
uses:
  NI::DAQmx::Internal::DAQmx Create Channel (AI-Voltage-Basic).gvi
  NI::DAQmx::Internal::DAQmx Timing (Sample Clock).gvi
  NI::DAQmx::Internal::DAQmx Start Task.gvi
  NI::DAQmx::Internal::DAQmx Stop Task.gvi
  NI::DAQmx::Internal::DAQmx Read (Analog Wfm 1Chan NSamp).gvi
  NI::Analysis::Measurement::Power Spectrum for 1 Chan.gvi
  NI::DAQmx::Internal::DAQmx Clear Task.gvi
  NI::DAQmx::Internal::DAQmx Create Channel (AO-Voltage-Basic).gvi
  NI::Analysis::Generation::Sine Wave.gvi
  NI::DAQmx::Internal::DAQmx Write (Analog 1D DBL 1Chan NSamp).gvi
  NI::DAQmx::Internal::DAQmx Is Task Done.gvi
  NI::G Core::Error::Display Error.gvi
diagram:
  w1 = $"Analog Input Frequency (Hz)"
  sequence {
    frame 0 {
      $stop <- FALSE
    }
  }
  Build Cluster(10, -10) -> w2
  call "DAQmx Create Channel (AI-Voltage-Basic).gvi"(error in=no error, physical channels=$"Analog input channel", measurement range=w2) -> (task out=w3, error out=w4)
  call "DAQmx Timing (Sample Clock).gvi"(task in=w3, error in=w4, rate=w1, sample mode="Continuous Samples"(10123)) -> (task out=w5, error out=w6)
  call "DAQmx Start Task.gvi"(task in=w5, error in=w6) -> (task out=w7, error out=w8)
  # Analog Input
  s1 = w8  # shift register
  while {
    w9 = $stop
    Feedback Node(initial value=w1, input=$"Analog Input Frequency (Hz)") -> w10
    Is Not Equal(x=$"Analog Input Frequency (Hz)", y=w10) -> w11
    Is First Call() -> w12
    Logical Or(w11, w12) -> w13
    case (w13) {
      frame False, Default {
        w14 = w7
        w15 = s1
      }
      frame True {
        call "DAQmx Stop Task.gvi"(task in=w7, error in=s1) -> (task out=w16, error out=w17)
        Property Node(instance in=w16, "SampClk_Rate_1344"=$"Analog Input Frequency (Hz)", error in=w17) -> (error out=w18, instance out=w19)
        call "DAQmx Start Task.gvi"(task in=w19, error in=w18) -> (task out=w14, error out=w15)
      }
    }
    call "DAQmx Read (Analog Wfm 1Chan NSamp).gvi"(task in=w14, error in=w15, number of samples per channel=100, timeout=10) -> (task out=w20, error out=w21, data=w22)
    $"Time Domain Data" <- w22
    Reciprocal(x=$"Analog Input Frequency (Hz)") -> w23
    Property Node(instance in=w22, "dt"=w23) -> (instance out=w24)
    call "Power Spectrum for 1 Chan.gvi"(signal=w24, error in=w21) -> (power spectrum=w25, error out=w26)
    $"Frequency Domain Data" <- w25
    next s1 = w26
    stop if w9
  }
  call "DAQmx Clear Task.gvi"(task in=w20, error in=s1) -> (error out=w27)
  call "DAQmx Create Channel (AO-Voltage-Basic).gvi"(physical channels=$"Analog output channel") -> (task out=w28, error out=w29)
  call "DAQmx Timing (Sample Clock).gvi"(task in=w28, error in=w29, rate=$"Analog Output Frequency (Hz)", sample mode="Continuous Samples"(10123)) -> (task out=w30, error out=w31)
  # Generate Initial Sin Wave
  w32 = 5000  # Cycles
  w33 = 100000  # Samples
  Divide(x=w32, y=w33) -> w34
  call "Sine Wave.gvi"(samples=100000, amplitude=5, frequency=w34, phase in=0, reset phase=TRUE, sample rate=1) -> (sine wave=w35)
  call "DAQmx Write (Analog 1D DBL 1Chan NSamp).gvi"(task in=w30, error in=w31, data=w35) -> (task out=w36, error out=w37)
  call "DAQmx Start Task.gvi"(task in=w36, error in=w37) -> (task out=w38, error out=w39)
  # Analog Output
  s2 = w39  # shift register
  while {
    Wait Until Next Multiple(multiple to wait=100)
    Multiply($"Analog Output Frequency (Hz)", 20) -> w40
    Property Node(instance in=w38, "SampClk_Rate_1344"=w40, error in=s2) -> (error out=w41, instance out=w42)
    call "DAQmx Is Task Done.gvi"(task in=w42, error in=w41) -> (task out=w43, error out=w44)
    $"Analog Output Frequency (Hz)_2" <- $"Analog Output Frequency (Hz)"
    next s2 = w44
    stop if $stop
  }
  call "DAQmx Clear Task.gvi"(task in=w43, error in=s2) -> (error out=w45)
  Merge Errors(w27, w45) -> (error out=w46)
  sequence {
    frame 0 {
      Not(x=w9) -> w47
      $stop <- w47
      call "Display Error.gvi"(error in=w46)
    }
  }
  $"Output SineWave" <- w35
