vi "Analog Output Voltage - Fan Control.gvi"   [LabVIEW NXG 2.0.0]
# This example demonstrates how to generate a user-defined voltage using the analog output of a DAQ device.
panel controls:
  "physical channel": "DAQmx Physical Channel" = "Dev1/ao0"
    # Physical Channel(s) specifies the names of the physical channels to use to create virtual channels. The DAQmx physical channel constant lists all physical channels on devices and modules installed in the system.
    # To specify a range of physical channels, use a colon between two channel numbers or two physical channel names:
    # Dev1/ao0:3
    # Dev1/ao0:Dev1/ao3
    # You can specify channel ranges in reverse order:
    # Dev1/ao4:0
    # Use commas to separate physical channel names and ranges in a list as follows:
    # Dev1/ao0, Dev1/ao2:3
  "min voltage": f64 = -10  # Min Voltage specifies the minimum value you will generate. This value is used to help determine the range of the DAC. The actual range will be coerced to one that your hardware supports. Refer to your device documentation for a list of available ranges.
  "max voltage": f64 = 10  # Max Voltage specifies the maximum value you expect to generate. This value is used to help determine the range of the DAC. The actual range will be coerced to one that your hardware supports. Refer to your device documentation for a list of available ranges.
  "stop": bool  # Stop stops the acquisition. It is recommended to stop your VI through this stop button so the DAQmx task can be properly cleared.
  "analog output voltage": f64
uses:
  NI::DAQmx::Internal::DAQmx Create Channel (AO-Voltage-Basic).gvi
  NI::DAQmx::Internal::DAQmx Start Task.gvi
  NI::DAQmx::Internal::DAQmx Write (Analog DBL 1Chan 1Samp).gvi
  NI::DAQmx::Internal::DAQmx Stop Task.gvi
  NI::DAQmx::Internal::DAQmx Clear Task.gvi
  NI::G Core::Error::Display Error.gvi
diagram:
  Build Cluster($"max voltage", $"min voltage") -> w1
  # Channel Settings
  call "DAQmx Create Channel (AO-Voltage-Basic).gvi"(physical channels=$"physical channel", output range=w1) -> (task out=w2, error out=w3)
  call "DAQmx Start Task.gvi"(task in=w2, error in=w3) -> (task out=w4, error out=w5)
  # Output
  while {
    Wait Until Next Multiple(multiple to wait=10)
    call "DAQmx Write (Analog DBL 1Chan 1Samp).gvi"(task in=w4, error in=w5, data=$"analog output voltage") -> (task out=w6, error out=w7)
    Property Node(instance in=w7) -> ("status"=w8)
    Logical Or(w8, $stop) -> w9
    stop if w9
  }
  call "DAQmx Write (Analog DBL 1Chan 1Samp).gvi"(task in=w6, error in=w7, data=0) -> (task out=w10, error out=w11)
  call "DAQmx Stop Task.gvi"(task in=w10, error in=w11) -> (task out=w12, error out=w13)
  call "DAQmx Clear Task.gvi"(task in=w12, error in=w13) -> (error out=w14)
  call "Display Error.gvi"(error in=w14)
