vi "Duty Cycle Measurement.gvi"   [LabVIEW NXG 2.0.0]
panel controls:
  "counter": "DAQmx Physical Channel"
  "starting edge": i32 = "Rising"(10280)  # starting edge specifies between which edges to measure the frequency or period of the signal. Name Description Falling Measure between falling edges. Rising Measure between rising edges.
  "maximum value": f64 = 10000  # maximum value specifies in units the maximum value you expect to measure.
  "minimum value": f64 = 2  # minimum value specifies in units the minimum value you expect to measure.
  "CI.DutyCycle.Term": "Terminal"  # Specifies the input terminal of the signal to measure.
panel indicators:
  "duty cycle": f64
uses:
  NI::DAQmx::Internal::DAQmx Create Channel (CI-Duty Cycle).gvi
  NI::DAQmx::Internal::DAQmx Start Task.gvi
  NI::DAQmx::Internal::DAQmx Read (Counter DBL 1Chan 1Samp).gvi
  NI::DAQmx::Internal::DAQmx Stop Task.gvi
  NI::DAQmx::Internal::DAQmx Clear Task.gvi
  NI::G Core::Error::Display Error.gvi
diagram:
  Build Cluster($"maximum value", $"minimum value") -> w1
  call "DAQmx Create Channel (CI-Duty Cycle).gvi"(counter=$counter, frequency range=w1, starting edge=$"starting edge") -> (task out=w2, error out=w3)
  Property Node(instance in=w2, "CI_DutyCycle_Term_308D"=$"CI.DutyCycle.Term", error in=w3) -> (error out=w4, instance out=w5)
  call "DAQmx Start Task.gvi"(task in=w5, error in=w4) -> (task out=w6, error out=w7)
  call "DAQmx Read (Counter DBL 1Chan 1Samp).gvi"(task in=w6, error in=w7) -> (task out=w8, error out=w9, data=w10)
  call "DAQmx Stop Task.gvi"(task in=w8, error in=w9) -> (task out=w11, error out=w12)
  call "DAQmx Clear Task.gvi"(task in=w11, error in=w12) -> (error out=w13)
  call "Display Error.gvi"(error in=w13)
  $"duty cycle" <- w10
