vi "Freq Measurement - High Freq 2 Counters.gvi"   [LabVIEW NXG 2.0.0]
panel controls:
  "counter": "DAQmx Physical Channel"
  "measurement time": f64 = 0.001  # measurement time is the length of time in seconds to measure the frequency or period of the signal, if measurement method is High Frequency with 2 Counters.
  "CI.Freq.Term": "Terminal"  # Specifies the input terminal of the signal to measure.
  "stop": bool
panel indicators:
  "Frequency (Hz)": f64
uses:
  NI::DAQmx::Internal::DAQmx Create Channel (CI-Frequency).gvi
  NI::DAQmx::Internal::DAQmx Start Task.gvi
  NI::DAQmx::Internal::DAQmx Read (Counter DBL 1Chan 1Samp).gvi
  NI::DAQmx::Internal::DAQmx Stop Task.gvi
  NI::DAQmx::Internal::DAQmx Clear Task.gvi
  NI::G Core::Error::Display Error.gvi
diagram:
  call "DAQmx Create Channel (CI-Frequency).gvi"(measurement time=$"measurement time", counter=$counter, measurement method="High Frequency with 2 Counters"(10157)) -> (task out=w1, error out=w2)
  Property Node(instance in=w1, "CI_Freq_Term_18A2"=$"CI.Freq.Term", error in=w2) -> (error out=w3, instance out=w4)
  call "DAQmx Start Task.gvi"(task in=w4, error in=w3) -> (task out=w5, error out=w6)
  s1 = w6  # shift register
  while {
    Wait Until Next Multiple(multiple to wait=100)
    call "DAQmx Read (Counter DBL 1Chan 1Samp).gvi"(task in=w5, error in=s1) -> (task out=w7, error out=w8, data=w9)
    Property Node(instance in=w8) -> ("status"=w10)
    Logical Or(w10, $stop) -> w11
    $"Frequency (Hz)" <- w9
    next s1 = w8
    stop if w11
  }
  call "DAQmx Stop Task.gvi"(task in=w7, error in=s1) -> (task out=w12, error out=w13)
  call "DAQmx Clear Task.gvi"(task in=w12, error in=w13) -> (error out=w14)
  call "Display Error.gvi"(error in=w14)
