vi "Freq Measurement - Large Range 2 Counters.gvi"   [LabVIEW NXG 2.0.0]
panel controls:
  "counter": "DAQmx Physical Channel"
  "CI.Freq.Term": "Terminal"  # Specifies the input terminal of the signal to measure.
  "stop": bool
  "divisor": u32 = 4  # divisor is the value by which to divide the input signal when measurement method is Large Range with 2 Counters. The larger the divisor, the more accurate the measurement. However, too large a value could cause the count register to roll over, which results in an incorrect measurement.
panel indicators:
  "Frequency (Hz)": f64
uses:
  NI::DAQmx::Internal::DAQmx Create Channel (CI-Frequency).gvi
  NI::DAQmx::Internal::DAQmx Start Task.gvi
  NI::DAQmx::Internal::DAQmx Read (Counter DBL 1Chan 1Samp).gvi
  NI::DAQmx::Internal::DAQmx Stop Task.gvi
  NI::DAQmx::Internal::DAQmx Clear Task.gvi
  NI::G Core::Error::Display Error.gvi
diagram:
  call "DAQmx Create Channel (CI-Frequency).gvi"(divisor=$divisor, counter=$counter, measurement method="Large Range with 2 Counters"(10205)) -> (task out=w1, error out=w2)
  Property Node(instance in=w1, "CI_Freq_Term_18A2"=$"CI.Freq.Term", error in=w2) -> (error out=w3, instance out=w4)
  call "DAQmx Start Task.gvi"(task in=w4, error in=w3) -> (task out=w5, error out=w6)
  s1 = w6  # shift register
  while {
    Wait Until Next Multiple(multiple to wait=100)
    call "DAQmx Read (Counter DBL 1Chan 1Samp).gvi"(task in=w5, error in=s1) -> (task out=w7, error out=w8, data=w9)
    Property Node(instance in=w8) -> ("status"=w10)
    Logical Or(w10, $stop) -> w11
    $"Frequency (Hz)" <- w9
    next s1 = w8
    stop if w11
  }
  call "DAQmx Stop Task.gvi"(task in=w7, error in=s1) -> (task out=w12, error out=w13)
  call "DAQmx Clear Task.gvi"(task in=w12, error in=w13) -> (error out=w14)
  call "Display Error.gvi"(error in=w14)
