vi "Pulse Width Measurement.gvi"   [LabVIEW NXG 2.0.0]
panel controls:
  "counter": "DAQmx Physical Channel"
  "starting edge": i32 = "Rising"(10280)  # starting edge specifies on which edge to begin measuring pulse width. Name Description Falling Begin measuring on the falling edge. The channel measures the width of low pulses. Rising Begin measuring on the rising edge. The channel measures the width of high pulses.
  "units": i32 = "Seconds"(10364)  # units specifies the units to use to return time or period measurements.
  "maximum value": f64 = 0.1  # maximum value specifies in units the maximum value you expect to measure.
  "minimum value": f64 = 1e-06  # minimum value specifies in units the minimum value you expect to measure.
  "CI.PulseWidth.Term": "Terminal"  # CI.PulseWidth.Term Specifies the input terminal of the signal to measure.
panel indicators:
  "pulse width": f64
uses:
  NI::DAQmx::Internal::DAQmx Create Channel (CI-Pulse Width).gvi
  NI::DAQmx::Internal::DAQmx Start Task.gvi
  NI::DAQmx::Internal::DAQmx Read (Counter DBL 1Chan 1Samp).gvi
  NI::DAQmx::Internal::DAQmx Stop Task.gvi
  NI::DAQmx::Internal::DAQmx Clear Task.gvi
  NI::G Core::Error::Display Error.gvi
diagram:
  Build Cluster($"maximum value", $"minimum value") -> w1
  call "DAQmx Create Channel (CI-Pulse Width).gvi"(counter=$counter, units=$units, measurement range=w1, starting edge=$"starting edge") -> (task out=w2, error out=w3)
  Property Node(instance in=w2, "CI_PulseWidth_Term_18AA"=$"CI.PulseWidth.Term", error in=w3) -> (error out=w4, instance out=w5)
  call "DAQmx Start Task.gvi"(task in=w5, error in=w4) -> (task out=w6, error out=w7)
  call "DAQmx Read (Counter DBL 1Chan 1Samp).gvi"(task in=w6, error in=w7) -> (task out=w8, error out=w9, data=w10)
  call "DAQmx Stop Task.gvi"(task in=w8, error in=w9) -> (task out=w11, error out=w12)
  call "DAQmx Clear Task.gvi"(task in=w11, error in=w12) -> (error out=w13)
  call "Display Error.gvi"(error in=w13)
  $"pulse width" <- w10
