vi "accelerometer logging.gvi"   [LabVIEW NXG 2.0.0]
# This example demonstrates how to continuously acquire buffered voltage measurements using a DAQmx device.
# For instructions on how to connect your signals to the DAQ device, refer to your device documentation.
panel controls:
  "Logging Mode": i32 = "Log and Read"(15842)  # Logging Mode specifies whether to enable logging. If you want to read data while logging, specify Log and Read mode. There is also a Log Only mode which writes data to disk but does not return data to LabVIEW. Log Only mode is not included here but is shown in the Logging Advanced example.
  "Physical Channel": "DAQmx Physical Channel" = "cDAQ1Mod7/ai0"
    # Physical Channel(s) specifies the names of the physical channels to use to create virtual channels. The DAQmx physical channel constant lists all physical channels on devices and modules installed in the system.
    # To specify a range of physical channels, use a colon between two channel numbers or two physical channel names:
    # Dev1/ai0:4
    # Dev1/ai0:Dev1/ai4
    # You can specify channel ranges in reverse order:
    # Dev1/ai4:0
    # Use commas to separate physical channel names and ranges in a list as follows:
    # Dev1/ai0, Dev1/ai3:6
  "Min Voltage": f64 = -5  # Min Voltage specifies the minimum value you expect to measure. This value is used to help determine the range of the ADC. The actual range will be coerced to one that your hardware supports. Refer to your device documentation for a list of available ranges.
  "Max Voltage": f64 = 5  # Max Voltage specifies the maximum value you expect to measure. This value is used to help determine the range of the ADC. The actual range will be coerced to one that your hardware supports. Refer to your device documentation for a list of available ranges.
  "Terminal Configuration": i32 = "default"(-1)  # Terminal Configuration specifies the input terminal configuration for the channel.
  "Sample Clock Source": "Terminal" = "OnboardClock"  # Sample Clock Source specifies the source terminal of the Sample Clock. Refer to the Device Routes table in Measurement and Automation Explorer to determine eligible sample clock sources.
  "Sample Rate": f64 = 1000  # Sample Rate specifies the sampling rate in samples per channel per second. If you use an external source for the Sample Clock, set this input to the maximum expected rate of that clock.
  "Number of Samples": i32 = 100  # Number of Samples specifies the number of samples to read.
  "TDMS File Path": path = path "C:\\Exercises\\Demonstrations\\Logging Example\\Test_1.tdms"  # TDMS File Path specifies the path to the TDMS file to which you want to log data.
  "Stop": bool  # Stop stops the acquisition. It is recommended to stop your VI through this stop button so the DAQmx task can be properly cleared.
  "Trigger Type": i32  # The Trigger Type tab control selects which trigger type you wish to use. Depending on the tab that is currently selected, when you run the VI your task will configure the desired trigger type. Note that not all hardware supports triggering--refer to your device documentation for more info.
  "Digital Start Trigger Source": "Terminal" = "/Dev1/PFI0"  # Digital Trigger Source specifies the name of a terminal where there is a digital signal to use as the source of the trigger. Refer to the Device Routes table in Measurement and Automation Explorer to determine eligible trigger sources.
  "Digital Start Trigger Edge": i32 = "Rising"(10280)  # Edge specifies on which edge of the digital signal to start acquiring or generating samples.
  "Digital Pause Trigger Source": "Terminal" = "/Dev1/PFI0"  # Pause Trigger Source specifies the name of a terminal where there is a digital signal to use as the source of the pause trigger. While the pause trigger is asserted, no sample clock edges will be registered. Refer to the Device Routes table in Measurement and Automation Explorer to determine eligible trigger sources.
  "Digital Pause Trigger Pause When": i32 = "High"(10192)  # Pause When specifies the state of the digital line that pauses the acquisition.
  "Analog Start Trigger Source": string = "APFI0"  # Analog Trigger Source is the name of a virtual channel or terminal where there is an analog signal to use as the source of the trigger. If you specify a virtual channel, all values will be in the engineering units (EU) of this virtual channel. If you specify a terminal, all values will be in volts (V). Not all hardware supports analog triggering. Refer to your device documentation for information on valid trigger sources. Some examples include: APFI0 Dev1/ai0
  "Analog Start Trigger Slope": i32 = "Rising"(10280)  # Slope specifies on which slope of the signal to start acquiring or generating samples when the signal crosses the desired level.
  "Analog Start Trigger Hysteresis": f64  # Hysteresis adds a window above or below the trigger level and often is used to reduce false triggering due to noise or jitter in the signal. When using hysteresis with a rising slope, the trigger asserts when the signal starts below the trigger level minus hysteresis and then crosses above level. The trigger deasserts when the signal crosses below level minus hysteresis.
  "Analog Start Trigger Level": f64  # Level specifies at what threshold to start acquiring or generating samples. Specify this value in the units of the measurement or generation. Use slope to specify on which slope to trigger at this threshold.
  "Analog Pause Trigger Level": f64  # Level specifies the threshold at which to pause the task. Specify this value in the units of the measurement or generation. Use pause when to specify whether the task pauses above or below this threshold.
  "Analog Pause Trigger Pause When": i32 = "Above Level"(10093)  # Pause When specifies to pause when the trigger source is above or below a specified level.
  "Analog Pause Trigger Source": string = "APFI0"
    # Analog Pause Trigger Source is the name of a virtual channel or terminal where there is an analog signal to use as the source of the pause trigger.
    # If you specify a virtual channel, all values will be in the engineering units (EU) of this virtual channel. If you specify a terminal, all values will be in volts (V).
    # Not all hardware supports analog triggering, and not all hardware supports pause triggering.  Refer to your device documentation  for information on valid trigger sources.
    # Some examples include:
    # APFI0
    # Dev1/ai0
panel indicators:
  "Actual Sample Rate": f64  # Actual Sample Rate returns the coerced value of the sample clock. If using OnboardClock as your Sample Clock Source, your hardware will attempt to derive the sample clock from one of its internal timebases. If it is unable to derive the exact frequency you require, the rate will be coerced.
  "Waveform Graph": waveform<f64>[]  # Waveform Graph displays the most recent acquired data.
uses:
  NI::DAQmx::Internal::DAQmx Create Channel (AI-Voltage-Basic).gvi
  NI::DAQmx::Internal::DAQmx Timing (Sample Clock).gvi
  NI::DAQmx::Internal::DAQmx Configure Logging (TDMS).gvi
  NI::DAQmx::Internal::DAQmx Start Trigger (Digital Edge).gvi
  NI::DAQmx::Internal::DAQmx Start Trigger (Analog Edge).gvi
  NI::DAQmx::Internal::DAQmx Start Task.gvi
  NI::DAQmx::Internal::DAQmx Read (Analog 1D Wfm NChan NSamp).gvi
  NI::DAQmx::Internal::DAQmx Stop Task.gvi
  NI::DAQmx::Internal::DAQmx Clear Task.gvi
  NI::G Core::Error::Display Error.gvi
diagram:
  w1 = $"Number of Samples"
  Build Cluster($"Max Voltage", $"Min Voltage") -> w2
  call "DAQmx Create Channel (AI-Voltage-Basic).gvi"(physical channels=$"Physical Channel", measurement range=w2, input terminal configuration=$"Terminal Configuration") -> (task out=w3, error out=w4)
  w5 = "Continuous Samples"(10123)  # Sample Mode
  # Channel Settings
  call "DAQmx Timing (Sample Clock).gvi"(task in=w3, error in=w4, rate=$"Sample Rate", source=$"Sample Clock Source", sample mode=w5, samples per channel=w1) -> (task out=w6, error out=w7)
  Property Node(instance in=w6, error in=w7) -> ("SampClk_Rate_1344"=w8, error out=w9, instance out=w10)
  w11 = string ""  # String Constant
  Type Cast(type=w11, x=$"Physical Channel") -> w12
  TDMS Open(error in=w9, file path=$"TDMS File Path", operation="open or create") -> (error out=w13, tdms file out=w14)
  TDMS Set Properties(channel name=w12, error in=w13, group name="mygroupname", property names=["Measurement Type"], property values=["X Acceleration"], tdms file=w14) -> (error out=w15, tdms file out=w16)
  TDMS Close(error in=w15, tdms file=w16) -> (error out=w17, file path out=w18)
  w19 = "Open or Create"(15846)  # Operation
  call "DAQmx Configure Logging (TDMS).gvi"(task in=w10, error in=w17, file path=w18, group name="mygroupname", logging mode=$"Logging Mode", operation=w19) -> (task out=w20, error out=w21)
  # Not all hardware supports all trigger types.
  # Refer to your device documentation for more information.
  # Trigger Settings
  # Logging Settings
  case ($"Trigger Type") {
    frame 0, Default {
      w22 = w20
      w23 = w21
    }
    frame 1 {
      call "DAQmx Start Trigger (Digital Edge).gvi"(task in=w20, error in=w21, source=$"Digital Start Trigger Source", edge=$"Digital Start Trigger Edge") -> (task out=w22, error out=w23)
    }
    frame 4 {
      call "DAQmx Start Trigger (Analog Edge).gvi"(task in=w20, error in=w21, source=$"Analog Start Trigger Source", slope=$"Analog Start Trigger Slope", level=$"Analog Start Trigger Level") -> (task out=w24, error out=w25)
      Property Node(instance in=w24, "Start_AnlgEdge_Hyst_1395"=$"Analog Start Trigger Hysteresis", error in=w25) -> (error out=w23, instance out=w22)
    }
    frame 2 {
      Property Node(instance in=w20, "Pause_TrigType_1366"="Digital Level"(10152), "Pause_DigLvl_Src_1379"=$"Digital Pause Trigger Source", "Pause_DigLvl_When_1380"=$"Digital Pause Trigger Pause When", error in=w21) -> (error out=w23, instance out=w22)
    }
    frame 5 {
      Property Node(instance in=w20, "Pause_TrigType_1366"="Analog Level"(10101), "Pause_AnlgLvl_Src_1370"=$"Analog Pause Trigger Source", "Pause_AnlgLvl_When_1371"=$"Analog Pause Trigger Pause When", "Pause_AnlgLvl_Lvl_1369"=$"Analog Pause Trigger Level", error in=w21) -> (error out=w23, instance out=w22)
    }
  }
  call "DAQmx Start Task.gvi"(task in=w22, error in=w23) -> (task out=w26, error out=w27)
  # Acquire Data
  while {
    call "DAQmx Read (Analog 1D Wfm NChan NSamp).gvi"(task in=w26, error in=w27, number of samples per channel=w1) -> (task out=w28, error out=w29, data=w30)
    $"Waveform Graph" <- w30
    Property Node(instance in=w29) -> ("status"=w31)
    Logical Or(w31, $Stop) -> w32
    stop if w32
  }
  call "DAQmx Stop Task.gvi"(task in=w28, error in=w29) -> (task out=w33, error out=w34)
  call "DAQmx Clear Task.gvi"(task in=w33, error in=w34) -> (error out=w35)
  call "Display Error.gvi"(error in=w35)
  $"Actual Sample Rate" <- w8
