vi "Simple Edge Counting - Finite Buffered.gvi"   [LabVIEW NXG 2.0.0]
panel controls:
  "counter": "DAQmx Physical Channel" = "cDAQ1/_ctr0"
  "count direction": i32 = "Count Up"(10128)
  "initial count": u32
  "edge": i32 = "Falling"(10171)
  "samples per channel": i32 = 1000
  "rate": f64 = 1000
  "source": "Terminal" = "/cDAQ1/PFI0"
panel indicators:
  "data": u32[]
uses:
  NI::DAQmx::Internal::DAQmx Create Channel (CI-Count Edges).gvi
  NI::DAQmx::Internal::DAQmx Timing (Sample Clock).gvi
  NI::DAQmx::Internal::DAQmx Start Task.gvi
  NI::DAQmx::Internal::DAQmx Read (Counter 1D U32 1Chan NSamp).gvi
  NI::DAQmx::Internal::DAQmx Clear Task.gvi
  NI::G Core::Error::Display Error.gvi
diagram:
  call "DAQmx Create Channel (CI-Count Edges).gvi"(counter=$counter, initial count=$"initial count", count direction=$"count direction", edge=$edge) -> (task out=w1, error out=w2)
  Property Node(instance in=w1, "CI_CountEdges_Term_18C7"="/cDAQ1/20MHzTimebase", error in=w2) -> (error out=w3, instance out=w4)
  call "DAQmx Timing (Sample Clock).gvi"(task in=w4, error in=w3, rate=$rate, source=$source, active edge="Rising"(10280), sample mode="Finite Samples"(10178), samples per channel=$"samples per channel") -> (task out=w5, error out=w6)
  call "DAQmx Start Task.gvi"(task in=w5, error in=w6) -> (task out=w7, error out=w8)
  call "DAQmx Read (Counter 1D U32 1Chan NSamp).gvi"(task in=w7, error in=w8) -> (task out=w9, error out=w10, data=w11)
  call "DAQmx Clear Task.gvi"(task in=w9, error in=w10) -> (error out=w12)
  call "Display Error.gvi"(error in=w12)
  $data <- w11
