vi "Simple Edge Counting - Gated.gvi"   [LabVIEW NXG 2.0.0]
panel controls:
  "counter": "DAQmx Physical Channel" = "cDAQ1/_ctr0"
  "count direction": i32 = "Count Up"(10128)
  "initial count": u32
  "edge": i32 = "Falling"(10171)
  "CI.CountEdges.Term": "Terminal" = "/cDAQ1/PFI1"
  "Pause.TrigType": i32 = "Digital Level"(10152)
  "Pause.DigLvl.Src": "Terminal" = "/cDAQ1/PFI0"
  "Pause.DigLvl.When": i32 = "Low"(10214)
  "stop": bool
panel indicators:
  "count": f64
uses:
  NI::DAQmx::Internal::DAQmx Create Channel (CI-Count Edges).gvi
  NI::DAQmx::Internal::DAQmx Start Task.gvi
  NI::DAQmx::Internal::DAQmx Read (Counter DBL 1Chan 1Samp).gvi
  NI::DAQmx::Internal::DAQmx Clear Task.gvi
  NI::G Core::Error::Display Error.gvi
diagram:
  call "DAQmx Create Channel (CI-Count Edges).gvi"(counter=$counter, initial count=$"initial count", count direction=$"count direction", edge=$edge) -> (task out=w1, error out=w2)
  Property Node(instance in=w1, "Pause_TrigType_1366"=$"Pause.TrigType", "Pause_DigLvl_Src_1379"=$"Pause.DigLvl.Src", "Pause_DigLvl_When_1380"=$"Pause.DigLvl.When", error in=w2) -> (error out=w3, instance out=w4)
  Property Node(instance in=w4, "CI_CountEdges_Term_18C7"=$"CI.CountEdges.Term", error in=w3) -> (error out=w5, instance out=w6)
  call "DAQmx Start Task.gvi"(task in=w6, error in=w5) -> (task out=w7, error out=w8)
  while {
    Wait Until Next Multiple(multiple to wait=100)
    call "DAQmx Read (Counter DBL 1Chan 1Samp).gvi"(task in=w7, error in=w8) -> (task out=w9, error out=w10, data=w11)
    $count <- w11
    Property Node(instance in=w10) -> ("status"=w12)
    Logical Or(w12, $stop) -> w13
    stop if w13
  }
  call "DAQmx Clear Task.gvi"(task in=w9, error in=w10) -> (error out=w14)
  call "Display Error.gvi"(error in=w14)
