vi "Counter - Read Encoder (Simplified).gvi"   [LabVIEW NXG 2.0.0]
# This example demonstrates how to use a counter to continually monitor the angular position of an encoder.
# For instructions on how to connect your signals to the DAQ device, refer to your device documentation.
panel controls:
  "pulses per revolution": u32 = 24  # Pulses per Revolution specifies the number of pulses the encoder generates per revolution. This value is the number of pulses on either signal A or signal B, not the total number of pulses on both signal A and signal B.
  "counter": "DAQmx Physical Channel"  # Counter specifies the names of the counter resource to use for the task.
  "stop": bool
  "z index enable": bool  # Z Index Enable specifies whether to use Z indexing for the channel.
  "loop time (ms)": u32  # Loop Time specifies the software delay introduced to the loop.
  "decoding type": i32 = "X4"(10092)  # decoding type specifies how to count and interpret the pulses the encoder generates on signal A and signal B. X1, X2, and X4 are valid for quadrature encoders only. Two Pulse Counting is valid only for two-pulse encoders.
panel indicators:
  "position": f64  # Position is the measured position based on channel parameters and the current count value.
types:
  T1 = cluster{"z index enable": bool, "z index value": f64, "z index phase": i32}
uses:
  NI::DAQmx::Internal::DAQmx Create Channel (CI-Position-Angular Encoder).gvi
  NI::DAQmx::Internal::DAQmx Start Task.gvi
  NI::DAQmx::Internal::DAQmx Read (Counter DBL 1Chan 1Samp).gvi
  NI::DAQmx::Internal::DAQmx Stop Task.gvi
  NI::DAQmx::Internal::DAQmx Clear Task.gvi
  NI::G Core::Error::Display Error.gvi
diagram:
  w1 = T1 {"z index enable"=FALSE, "z index value"=0, "z index phase"=10040}
  Property Node(instance in=w1, "z index enable"=$"z index enable") -> (instance out=w2)
  call "DAQmx Create Channel (CI-Position-Angular Encoder).gvi"(pulses per revolution=$"pulses per revolution", counter=$counter, z index=w2, decoding type=$"decoding type") -> (task out=w3, error out=w4)
  call "DAQmx Start Task.gvi"(task in=w3, error in=w4) -> (task out=w5, error out=w6)
  while {
    Wait Until Next Multiple(multiple to wait=$"loop time (ms)")
    call "DAQmx Read (Counter DBL 1Chan 1Samp).gvi"(task in=w5, error in=w6) -> (task out=w7, error out=w8, data=w9)
    Property Node(instance in=w8) -> ("status"=w10)
    Logical Or(w10, $stop) -> w11
    $position <- w9
    stop if w11
  }
  call "DAQmx Stop Task.gvi"(task in=w7, error in=w8) -> (task out=w12, error out=w13)
  call "DAQmx Clear Task.gvi"(task in=w12, error in=w13) -> (error out=w14)
  call "Display Error.gvi"(error in=w14)
