vi "Simultaneous Start.gvi"   [LabVIEW NXG 2.0.0]
panel controls:
  "input rate": f64 = 1000
  "output rate": f64 = 1000
  "samples per channel": i32 = 1000
  "AI channel": "DAQmx Physical Channel"
  "AO channel": "DAQmx Physical Channel"
panel indicators:
  "signal out": waveform<f64>
  "1st samples": f64[]
uses:
  NI::DAQmx::Internal::DAQmx Create Channel (AI-Voltage-Basic).gvi
  NI::DAQmx::Internal::DAQmx Timing (Sample Clock).gvi
  NI::DAQmx::Internal::DAQmx Create Channel (AO-Voltage-Basic).gvi
  NI::Analysis::Generation::Sine Waveform.gvi
  NI::DAQmx::Internal::DAQmx Write (Analog Wfm 1Chan NSamp).gvi
  NI::DAQmx::Internal::DAQmx Start Task.gvi
  NI::DAQmx::Internal::DAQmx Read (Analog 1D DBL 1Chan NSamp).gvi
  NI::DAQmx::Internal::DAQmx Clear Task.gvi
  NI::DAQmx::Internal::DAQmx Wait Until Done.gvi
  NI::G Core::Error::Display Error.gvi
diagram:
  call "DAQmx Create Channel (AI-Voltage-Basic).gvi"(physical channels=$"AI channel") -> (task out=w1, error out=w2)
  call "DAQmx Timing (Sample Clock).gvi"(task in=w1, error in=w2, rate=$"input rate", sample mode="Finite Samples"(10178), samples per channel=$"samples per channel") -> (task out=w3, error out=w4)
  call "DAQmx Create Channel (AO-Voltage-Basic).gvi"(physical channels=$"AO channel") -> (task out=w5, error out=w6)
  call "DAQmx Timing (Sample Clock).gvi"(task in=w5, error in=w6, rate=$"output rate", sample mode="Finite Samples"(10178)) -> (task out=w7, error out=w8)
  call "Sine Waveform.gvi"(amplitude=1, error in=w8) -> (sine wave=w9, error out=w10)
  call "DAQmx Write (Analog Wfm 1Chan NSamp).gvi"(task in=w7, error in=w10, data=w9) -> (task out=w11, error out=w12)
  sequence {
    frame 0 {
      call "DAQmx Start Task.gvi"(task in=w3, error in=w4) -> (task out=w13, error out=w14)
      call "DAQmx Start Task.gvi"(task in=w11, error in=w12) -> (task out=w15, error out=w16)
    }
  }
  call "DAQmx Read (Analog 1D DBL 1Chan NSamp).gvi"(task in=w13, error in=w14, number of samples per channel=$"samples per channel") -> (task out=w17, error out=w18, data=w19)
  call "DAQmx Clear Task.gvi"(task in=w17, error in=w18) -> (error out=w20)
  call "DAQmx Wait Until Done.gvi"(task in=w15, error in=w16) -> (task out=w21, error out=w22)
  call "DAQmx Clear Task.gvi"(task in=w21, error in=w22) -> (error out=w23)
  Merge Errors(w20, w23) -> (error out=w24)
  call "Display Error.gvi"(error in=w24)
  $"1st samples" <- w19
  $"signal out" <- w9
