vi "Timebase Synchronization.gvi"   [LabVIEW NXG 2.0.0]
panel controls:
  "physical channel - light sensor": "DAQmx Physical Channel" = "cDAQ1Mod8/ai0"
  "sample rate - light sensor": f64 = 1000
  "samples to read - light sensor": i32 = 1000
  "physical channel - thermocouple": "DAQmx Physical Channel" = "cDAQ1Mod2/ai0"
  "sample rate - thermocouple": f64 = 1000
  "samples to read - thermocouple": i32 = 1000
  "stop button": bool
panel indicators:
  "light sensor data": waveform<f64>
  "thermocouple data": waveform<f64>
uses:
  NI::DAQmx::Internal::DAQmx Create Channel (AI-Voltage-Basic).gvi
  NI::DAQmx::Internal::DAQmx Timing (Sample Clock).gvi
  NI::DAQmx::Internal::DAQmx Start Trigger (Digital Edge).gvi
  NI::DAQmx::Internal::DAQmx Start Task.gvi
  NI::DAQmx::Internal::DAQmx Read (Analog Wfm 1Chan NSamp).gvi
  NI::DAQmx::Internal::DAQmx Stop Task.gvi
  NI::DAQmx::Internal::DAQmx Clear Task.gvi
  NI::G Core::Error::Display Error.gvi
  NI::DAQmx::Internal::DAQmx Create Channel (AI-Temperature-Thermocouple).gvi
diagram:
  call "DAQmx Create Channel (AI-Voltage-Basic).gvi"(physical channels=$"physical channel - light sensor") -> (task out=w1, error out=w2)
  call "DAQmx Timing (Sample Clock).gvi"(task in=w1, error in=w2, rate=$"sample rate - light sensor", sample mode="Continuous Samples"(10123))
  call "DAQmx Start Trigger (Digital Edge).gvi"() -> (task out=w3, error out=w4)
  call "DAQmx Start Task.gvi"(task in=w3, error in=w4) -> (task out=w5, error out=w6)
  call "DAQmx Start Trigger (Digital Edge).gvi"() -> (task out=w7, error out=w8)
  call "DAQmx Start Task.gvi"(task in=w7, error in=w8) -> (task out=w9, error out=w10)
  s1 = w6  # shift register
  s2 = w5  # shift register
  s3 = w10  # shift register
  s4 = w9  # shift register
  while {
    call "DAQmx Read (Analog Wfm 1Chan NSamp).gvi"(task in=s4, error in=s3, number of samples per channel=$"samples to read - light sensor") -> (task out=w11, error out=w12, data=w13)
    $"light sensor data" <- w13
    call "DAQmx Read (Analog Wfm 1Chan NSamp).gvi"(task in=s2, error in=s1, number of samples per channel=$"samples to read - thermocouple") -> (task out=w14, error out=w15, data=w16)
    $"thermocouple data" <- w16
    Logical Or(w12, w15, $"stop button") -> w17
    next s1 = w15
    next s2 = w14
    next s3 = w12
    next s4 = w11
    stop if w17
  }
  call "DAQmx Stop Task.gvi"(task in=s4, error in=s3) -> (task out=w18, error out=w19)
  call "DAQmx Clear Task.gvi"(task in=w18, error in=w19) -> (error out=w20)
  call "DAQmx Stop Task.gvi"(task in=s2, error in=s1) -> (task out=w21, error out=w22)
  call "DAQmx Clear Task.gvi"(task in=w21, error in=w22) -> (error out=w23)
  Merge Errors(w20, w23) -> (error out=w24)
  call "Display Error.gvi"(error in=w24)
  call "DAQmx Create Channel (AI-Temperature-Thermocouple).gvi"(physical channels=$"physical channel - thermocouple", units="Deg C"(10143), thermocouple type="J"(10072)) -> (task out=w25, error out=w26)
  call "DAQmx Timing (Sample Clock).gvi"(task in=w25, error in=w26, rate=$"sample rate - thermocouple", sample mode="Continuous Samples"(10123))
