vi "Tone generation.gvi"   [LabVIEW NXG 2.0.0]
uses:
  NI::DAQmx::Internal::DAQmx Create Channel (AO-Voltage-Basic).gvi
  NI::DAQmx::Internal::DAQmx Timing (Sample Clock).gvi
  NI::Analysis::Generation::Sine Waveform.gvi
  NI::DAQmx::Internal::DAQmx Write (Analog Wfm 1Chan NSamp).gvi
  NI::DAQmx::Internal::DAQmx Start Task.gvi
  NI::DAQmx::Internal::DAQmx Wait Until Done.gvi
  NI::DAQmx::Internal::DAQmx Stop Task.gvi
  NI::DAQmx::Internal::DAQmx Clear Task.gvi
  NI::G Core::Error::Display Error.gvi
diagram:
  call "DAQmx Create Channel (AO-Voltage-Basic).gvi"(physical channels="cDAQ1Mod4/ao0") -> (task out=w1, error out=w2)
  call "DAQmx Timing (Sample Clock).gvi"(task in=w1, error in=w2, rate=40000, sample mode="Finite Samples"(10178), samples per channel=40000) -> (task out=w3, error out=w4)
  call "Sine Waveform.gvi"(amplitude=0.005, frequency=800, sample rate=40000, samples=40000) -> (sine wave=w5)
  call "DAQmx Write (Analog Wfm 1Chan NSamp).gvi"(task in=w3, error in=w4, data=w5) -> (task out=w6, error out=w7)
  call "DAQmx Start Task.gvi"(task in=w6, error in=w7) -> (task out=w8, error out=w9)
  call "DAQmx Wait Until Done.gvi"(task in=w8, error in=w9, timeout=30) -> (task out=w10, error out=w11)
  call "DAQmx Stop Task.gvi"(task in=w10, error in=w11) -> (task out=w12, error out=w13)
  call "DAQmx Clear Task.gvi"(task in=w12, error in=w13) -> (error out=w14)
  call "Display Error.gvi"(error in=w14)
