vi "Software-Timed Input with Voltage Probe.gvi"   [LabVIEW NXG 2.0.0]
panel controls:
  "Physical Channel": "DAQmx Physical Channel" = "cDAQ1Mod8/ai0"
  "Input Terminal Configuration": i32 = "Default"(-1)
  "Stop": bool
  "Loop Rate (ms)": u32 = 50
  "minimum value": f64
  "maximum value": f64 = 0.5
panel indicators:
  "Chart": waveform<f64>[]
types:
  T1 = cluster{"maximum value": f64, "minimum value": f64}
uses:
  NI::DAQmx::Internal::DAQmx Create Task.gvi
  NI::DAQmx::Internal::DAQmx Create Channel (AI-Voltage-Basic).gvi
  NI::DAQmx::Internal::DAQmx Start Task.gvi
  NI::DAQmx::Internal::DAQmx Read (Analog 1D Wfm NChan NSamp).gvi
  NI::DAQmx::Internal::DAQmx Stop Task.gvi
  NI::DAQmx::Internal::DAQmx Clear Task.gvi
  NI::G Core::Error::Display Error.gvi
diagram:
  Property Node(instance in=T1 {"maximum value"=5, "minimum value"=-5}, "minimum value"=$"minimum value", "maximum value"=$"maximum value") -> (instance out=w1)
  call "DAQmx Create Task.gvi"() -> (task out=w2, error out=w3)
  # Channel Settings
  call "DAQmx Create Channel (AI-Voltage-Basic).gvi"(task in=w2, error in=w3, physical channels=$"Physical Channel", measurement range=w1, input terminal configuration=$"Input Terminal Configuration") -> (task out=w4, error out=w5)
  call "DAQmx Start Task.gvi"(task in=w4, error in=w5) -> (task out=w6, error out=w7)
  # Acquire Data
  while {
    Wait(time to wait=$"Loop Rate (ms)")
    call "DAQmx Read (Analog 1D Wfm NChan NSamp).gvi"(task in=w6, error in=w7, number of samples per channel=10) -> (task out=w8, error out=w9, data=w10)
    Property Node(instance in=w9) -> ("status"=w11, instance out=w12)
    Logical Or(w11, $Stop) -> w13
    $Chart <- w10
    stop if w13
  }
  call "DAQmx Stop Task.gvi"(task in=w8, error in=w12) -> (task out=w14, error out=w15)
  call "DAQmx Clear Task.gvi"(task in=w14, error in=w15) -> (error out=w16)
  call "Display Error.gvi"(type of dialog="OK message + warnings", error in=w16)
