vi "Continuous Digital Output.gvi"   [LabVIEW NXG 2.0.0]
# This example demonstrates how to generate a continuous amount of digital data based off of a sample clock.
# Some hardware (e.g. M Series DAQ) must use an external sample clock for digital tasks.  To view a complete list of available sample clock sources, consult the Device Routes table in Measurement and Automation Explorer.
# For instructions on how to connect your signals to the DAQ device, refer to your device documentation.
panel controls:
  "Sample Rate": f64 = 10
  "Samples per Channel": i32 = 255
  "Stop": bool
  "Physical Channel": "DAQmx Physical Channel" = "cDAQ1Mod3/port0/line0:7"
  "Sample Clock Source": "Terminal" = "OnboardClock"
panel indicators:
  "Digital Graph": DigitalWaveform
uses:
  NI::DAQmx::Internal::DAQmx Create Task.gvi
  NI::DAQmx::Internal::DAQmx Create Channel (DO-Digital Output).gvi
  NI::DAQmx::Internal::DAQmx Timing (Sample Clock).gvi
  NI::G Core::Waveform::Digital Waveform::Digital Pattern Generator (Ramp).gvi
  NI::DAQmx::Internal::DAQmx Write (Digital Wfm 1Chan NSamp).gvi
  NI::DAQmx::Internal::DAQmx Start Task.gvi
  NI::DAQmx::Internal::DAQmx Is Task Done.gvi
  NI::DAQmx::Internal::DAQmx Stop Task.gvi
  NI::DAQmx::Internal::DAQmx Write (Digital U8 1Chan 1Samp).gvi
  NI::DAQmx::Internal::DAQmx Clear Task.gvi
  NI::G Core::Error::Display Error.gvi
diagram:
  # Channel Settings
  w1 = "one channel for all lines"(1)  # Line Grouping
  call "DAQmx Create Task.gvi"() -> (task out=w2, error out=w3)
  call "DAQmx Create Channel (DO-Digital Output).gvi"(task in=w2, error in=w3, lines=$"Physical Channel", line grouping=w1) -> (task out=w4, error out=w5)
  w6 = "Continuous Samples"(10123)  # Sample Mode
  # Timing Settings
  call "DAQmx Timing (Sample Clock).gvi"(task in=w4, error in=w5, rate=$"Sample Rate", source=$"Sample Clock Source", sample mode=w6, samples per channel=$"Samples per Channel") -> (task out=w7, error out=w8)
  Property Node(instance in=w7, error in=w8) -> ("SampClk_Rate_1344"=w9, error out=w10, instance out=w11)
  # The pattern being output will repeat once completed because regeneration of data is enabled by default.
  Property Node(instance in=w11, error in=w10) -> ("DO_NumLines_2179"=w12, error out=w13, instance out=w14)
  # Write Data
  call "Digital Pattern Generator (Ramp).gvi"(number of samples=$"Samples per Channel", number of signals=w12, sample rate=w9) -> (digital waveform=w15)
  call "DAQmx Write (Digital Wfm 1Chan NSamp).gvi"(task in=w14, error in=w13, data=w15) -> (task out=w16, error out=w17)
  call "DAQmx Start Task.gvi"(task in=w16, error in=w17) -> (task out=w18, error out=w19)
  while {
    w20 = 100  # milliseconds to wait
    Wait(time to wait=w20)
    call "DAQmx Is Task Done.gvi"(task in=w18, error in=w19) -> (task out=w21, error out=w22)
    Property Node(instance in=w22) -> ("status"=w23, instance out=w24)
    Logical Or(w23, $Stop) -> w25
    stop if w25
  }
  call "DAQmx Stop Task.gvi"(task in=w21, error in=w24) -> (task out=w26, error out=w27)
  call "DAQmx Write (Digital U8 1Chan 1Samp).gvi"(task in=w26, error in=w27, data=0) -> (task out=w28, error out=w29)
  call "DAQmx Clear Task.gvi"(task in=w28, error in=w29) -> (error out=w30)
  call "Display Error.gvi"(type of dialog="OK message + warnings", error in=w30)
  $"Digital Graph" <- w15
