vi "On Demand Digital Output.gvi"   [LabVIEW NXG 2.0.0]
# This example demonstrates how to generate digital output data using software timing.
# For instructions on how to connect your signals from  the DAQ device, refer to your device documentation.
panel controls:
  "Loop Rate (ms)": u32 = 100
  "Stop": bool
  "Physical Channel": "DAQmx Physical Channel" = "cDAQ1Mod3/port0/line0:7"
  "Data to Write": bool[] = [FALSE, FALSE, FALSE, FALSE, FALSE, FALSE, FALSE, FALSE]
uses:
  NI::DAQmx::Internal::DAQmx Create Task.gvi
  NI::DAQmx::Internal::DAQmx Create Channel (DO-Digital Output).gvi
  NI::DAQmx::Internal::DAQmx Start Task.gvi
  NI::DAQmx::Internal::DAQmx Write (Digital 1D Bool 1Chan 1Samp).gvi
  NI::DAQmx::Internal::DAQmx Stop Task.gvi
  NI::DAQmx::Internal::DAQmx Clear Task.gvi
  NI::G Core::Error::Display Error.gvi
diagram:
  call "DAQmx Create Task.gvi"() -> (task out=w1, error out=w2)
  # Channel Settings
  call "DAQmx Create Channel (DO-Digital Output).gvi"(task in=w1, error in=w2, lines=$"Physical Channel") -> (task out=w3, error out=w4)
  Property Node(instance in=w3, error in=w4) -> ("DO_NumBooleansPerChan_217F"=w5, error out=w6, instance out=w7)
  call "DAQmx Start Task.gvi"(task in=w7, error in=w6) -> (task out=w8, error out=w9)
  # Generate Digital Signal
  while {
    Wait(time to wait=$"Loop Rate (ms)")
    Array Subset(array=$"Data to Write", length0=w5) -> w10
    call "DAQmx Write (Digital 1D Bool 1Chan 1Samp).gvi"(task in=w8, error in=w9, data=w10) -> (task out=w11, error out=w12)
    Property Node(instance in=w12) -> ("status"=w13, instance out=w14)
    Logical Or(w13, $Stop) -> w15
    stop if w15
  }
  call "DAQmx Stop Task.gvi"(task in=w11, error in=w14) -> (task out=w16, error out=w17)
  call "DAQmx Clear Task.gvi"(task in=w16, error in=w17) -> (error out=w18)
  call "Display Error.gvi"(type of dialog="OK message + warnings", error in=w18)
