vi "On Demand Digital Output_challenge.gvi"   [LabVIEW NXG 2.0.0]
# This example demonstrates how to generate digital output data using software timing.
# For instructions on how to connect your signals from  the DAQ device, refer to your device documentation.
panel controls:
  "Loop Rate (ms)": u32 = 100
  "Stop": bool
  "Physical Channel": "DAQmx Physical Channel" = "cDAQ1Mod3/port0/line0:7"
  "data": u8
uses:
  NI::DAQmx::Internal::DAQmx Create Task.gvi
  NI::DAQmx::Internal::DAQmx Create Channel (DO-Digital Output).gvi
  NI::DAQmx::Internal::DAQmx Start Task.gvi
  NI::DAQmx::Internal::DAQmx Write (Digital U8 1Chan 1Samp).gvi
  NI::DAQmx::Internal::DAQmx Stop Task.gvi
  NI::DAQmx::Internal::DAQmx Clear Task.gvi
  NI::G Core::Error::Display Error.gvi
diagram:
  call "DAQmx Create Task.gvi"() -> (task out=w1, error out=w2)
  # Channel Settings
  call "DAQmx Create Channel (DO-Digital Output).gvi"(task in=w1, error in=w2, lines=$"Physical Channel") -> (task out=w3, error out=w4)
  call "DAQmx Start Task.gvi"(task in=w3, error in=w4) -> (task out=w5, error out=w6)
  # Generate Digital Signal
  while {
    Wait(time to wait=$"Loop Rate (ms)")
    call "DAQmx Write (Digital U8 1Chan 1Samp).gvi"(task in=w5, error in=w6, data=$data) -> (task out=w7, error out=w8)
    Property Node(instance in=w8) -> ("status"=w9, instance out=w10)
    Logical Or(w9, $Stop) -> w11
    stop if w11
  }
  call "DAQmx Stop Task.gvi"(task in=w7, error in=w10) -> (task out=w12, error out=w13)
  call "DAQmx Clear Task.gvi"(task in=w12, error in=w13) -> (error out=w14)
  call "Display Error.gvi"(type of dialog="OK message + warnings", error in=w14)
