vi "Control Multiple LEDs.gvi"   [LabVIEW NXG 2.0.0]
panel controls:
  "lines": "DAQmx Physical Channel" = "cDAQ1Mod3/port0/line0:7"
  "Device Power Status": bool[] = [FALSE, FALSE, FALSE, FALSE, FALSE, FALSE, FALSE, FALSE]
uses:
  NI::DAQmx::Internal::DAQmx Create Channel (DO-Digital Output).gvi
  NI::DAQmx::Internal::DAQmx Start Task.gvi
  NI::DAQmx::Internal::DAQmx Write (Digital 1D Bool 1Chan 1Samp).gvi
  NI::DAQmx::Internal::DAQmx Stop Task.gvi
  NI::G Core::Error::Display Error.gvi
diagram:
  call "DAQmx Create Channel (DO-Digital Output).gvi"(lines=$lines, line grouping="One Channel For All Lines"(1)) -> (task out=w1, error out=w2)
  call "DAQmx Start Task.gvi"(task in=w1, error in=w2) -> (task out=w3, error out=w4)
  Reverse 1D Array(array=$"Device Power Status") -> (reversed array=w5)
  call "DAQmx Write (Digital 1D Bool 1Chan 1Samp).gvi"(task in=w3, error in=w4, data=w5) -> (task out=w6, error out=w7)
  call "DAQmx Stop Task.gvi"(task in=w6, error in=w7) -> (error out=w8)
  call "Display Error.gvi"(error in=w8)
