vi "Light Sensor Acquisition with Analysis.gvi"   [LabVIEW NXG 2.0.0]
panel controls:
  "light sensor input": "DAQmx Physical Channel" = "cDAQ1Mod8/ai0"
  "rate": f64 = 1000
  "samples per channel": i32 = 500
panel indicators:
  "light sensor data": waveform<f64>
  "average voltage": f64
  "maximum voltage": f64  # Y max is the maximum data value of the waveform.
  "mininum voltage": f64  # Y min is the minimum data value of the waveform.
uses:
  NI::DAQmx::Internal::DAQmx Create Channel (AI-Voltage-Basic).gvi
  NI::DAQmx::Internal::DAQmx Timing (Sample Clock).gvi
  NI::DAQmx::Internal::DAQmx Start Task.gvi
  NI::DAQmx::Internal::DAQmx Read (Analog Wfm 1Chan NSamp).gvi
  NI::DAQmx::Internal::DAQmx Clear Task.gvi
  NI::G Core::Error::Display Error.gvi
  NI::Analysis::Statistics::Mean (DBL).gvi
  NI::G Core::Waveform::Analog Waveform::Waveform Min Max.gvi
diagram:
  call "DAQmx Create Channel (AI-Voltage-Basic).gvi"(physical channels=$"light sensor input") -> (task out=w1, error out=w2)
  call "DAQmx Timing (Sample Clock).gvi"(task in=w1, error in=w2, rate=$rate, sample mode="Finite Samples"(10178), samples per channel=$"samples per channel") -> (task out=w3, error out=w4)
  call "DAQmx Start Task.gvi"(task in=w3, error in=w4) -> (task out=w5, error out=w6)
  call "DAQmx Read (Analog Wfm 1Chan NSamp).gvi"(task in=w5, error in=w6) -> (task out=w7, error out=w8, data=w9)
  call "DAQmx Clear Task.gvi"(task in=w7, error in=w8) -> (error out=w10)
  call "Display Error.gvi"(error in=w10)
  $"light sensor data" <- w9
  call "Mean (DBL).gvi"(x=w9) -> (mean=w11)
  $"average voltage" <- w11
  call "Waveform Min Max.gvi"(waveform=w9) -> (Y max=w12, Y min=w13)
  $"maximum voltage" <- w12
  $"mininum voltage" <- w13
