vi "Light Sensor Acquisition.gvi"   [LabVIEW NXG 2.0.0]
panel controls:
  "light sensor input": "DAQmx Physical Channel" = "cDAQ1Mod8/ai0"
  "rate": f64 = 1000
  "samples per channel": i32 = 500
panel indicators:
  "light sensor data": waveform<f64>
uses:
  NI::DAQmx::Internal::DAQmx Create Channel (AI-Voltage-Basic).gvi
  NI::DAQmx::Internal::DAQmx Timing (Sample Clock).gvi
  NI::DAQmx::Internal::DAQmx Start Task.gvi
  NI::DAQmx::Internal::DAQmx Read (Analog Wfm 1Chan NSamp).gvi
  NI::DAQmx::Internal::DAQmx Clear Task.gvi
  NI::G Core::Error::Display Error.gvi
diagram:
  call "DAQmx Create Channel (AI-Voltage-Basic).gvi"(physical channels=$"light sensor input") -> (task out=w1, error out=w2)
  call "DAQmx Timing (Sample Clock).gvi"(task in=w1, error in=w2, rate=$rate, sample mode="Finite Samples"(10178), samples per channel=$"samples per channel") -> (task out=w3, error out=w4)
  call "DAQmx Start Task.gvi"(task in=w3, error in=w4) -> (task out=w5, error out=w6)
  call "DAQmx Read (Analog Wfm 1Chan NSamp).gvi"(task in=w5, error in=w6) -> (task out=w7, error out=w8, data=w9)
  call "DAQmx Clear Task.gvi"(task in=w7, error in=w8) -> (error out=w10)
  call "Display Error.gvi"(error in=w10)
  $"light sensor data" <- w9
