vi "Read Fan Acceleration.gvi"   [LabVIEW NXG 2.0.0]
panel controls:
  "input terminal configuration": i32 = "Default"(-1)
  "physical channel": "DAQmx Physical Channel" = "cDAQ1Mod7/ai0"
  "Max Voltage": f64 = 5
  "Min Voltage": f64 = -5
  "sample rate": f64 = 1000
  "sample clock source": "Terminal" = "OnboardClock"
  "number of samples": i32 = 100
  "stop": bool
panel indicators:
  "waveform graph": waveform<f64>[]
uses:
  NI::DAQmx::Internal::DAQmx Create Channel (AI-Voltage-Basic).gvi
  NI::DAQmx::Internal::DAQmx Timing (Sample Clock).gvi
  NI::DAQmx::Internal::DAQmx Start Task.gvi
  NI::DAQmx::Internal::DAQmx Read (Analog 1D Wfm NChan NSamp).gvi
  NI::DAQmx::Internal::DAQmx Stop Task.gvi
  NI::DAQmx::Internal::DAQmx Clear Task.gvi
  NI::G Core::Error::Display Error.gvi
diagram:
  w1 = $"number of samples"
  Build Cluster($"Max Voltage", $"Min Voltage") -> w2
  call "DAQmx Create Channel (AI-Voltage-Basic).gvi"(physical channels=$"physical channel", measurement range=w2, input terminal configuration=$"input terminal configuration") -> (task out=w3, error out=w4)
  call "DAQmx Timing (Sample Clock).gvi"(task in=w3, error in=w4, rate=$"sample rate", source=$"sample clock source", sample mode="Continuous Samples"(10123), samples per channel=w1) -> (task out=w5, error out=w6)
  call "DAQmx Start Task.gvi"(task in=w5, error in=w6) -> (task out=w7, error out=w8)
  while {
    call "DAQmx Read (Analog 1D Wfm NChan NSamp).gvi"(task in=w7, error in=w8, number of samples per channel=w1) -> (task out=w9, error out=w10, data=w11)
    $"waveform graph" <- w11
    Logical Or(w10, $stop) -> w12
    stop if w12
  }
  call "DAQmx Stop Task.gvi"(task in=w9, error in=w10) -> (task out=w13, error out=w14)
  call "DAQmx Clear Task.gvi"(task in=w13, error in=w14) -> (error out=w15)
  call "Display Error.gvi"(error in=w15)
