vi "Fan Speed Control.gvi"   [LabVIEW NXG 2.0.0]
panel controls:
  "physical channels": "DAQmx Physical Channel" = "cDAQ1Mod4/ao1"
  "max voltage": f64 = 5
  "min voltage": f64
  "stop": bool
  "fan speed": f64
panel indicators:
  "Chart": f64
types:
  T1 = cluster{"maximum value": f64, "minimum value": f64}
uses:
  NI::DAQmx::Internal::DAQmx Create Channel (AO-Voltage-Basic).gvi
  NI::DAQmx::Internal::DAQmx Start Task.gvi
  NI::DAQmx::Internal::DAQmx Write (Analog DBL 1Chan 1Samp).gvi
  NI::DAQmx::Internal::DAQmx Stop Task.gvi
  NI::DAQmx::Internal::DAQmx Clear Task.gvi
  NI::G Core::Error::Display Error.gvi
diagram:
  Property Node(instance in=T1 {"maximum value"=10, "minimum value"=-10}, "maximum value"=$"max voltage", "minimum value"=$"min voltage") -> (instance out=w1)
  call "DAQmx Create Channel (AO-Voltage-Basic).gvi"(physical channels=$"physical channels", output range=w1) -> (task out=w2, error out=w3)
  call "DAQmx Start Task.gvi"(task in=w2, error in=w3) -> (task out=w4, error out=w5)
  while {
    Wait Until Next Multiple(multiple to wait=10)
    call "DAQmx Write (Analog DBL 1Chan 1Samp).gvi"(task in=w4, error in=w5, data=$"fan speed", auto start=FALSE) -> (task out=w6, error out=w7)
    Logical Or(w7, $stop) -> w8
    $Chart <- $"fan speed"
    stop if w8
  }
  call "DAQmx Write (Analog DBL 1Chan 1Samp).gvi"(task in=w6, error in=w7, data=0) -> (task out=w9, error out=w10)
  call "DAQmx Stop Task.gvi"(task in=w9, error in=w10) -> (task out=w11, error out=w12)
  call "DAQmx Clear Task.gvi"(task in=w11, error in=w12) -> (error out=w13)
  call "Display Error.gvi"(error in=w13)
