vi "Solar Panel Test_Challenge.gvi"   [LabVIEW NXG 2.0.0]
panel controls:
  "voltage channel": "DAQmx Physical Channel" = "cDAQ1Mod8/ai0"
  "Input Terminal Configuration": i32 = "Default"(-1)
  "Stop": bool
  "sample rate": f64 = 10
  "minimum value": f64
  "maximum value": f64 = 0.5
  "thermocouple type": i32 = "J"(10072)
  "temperature channels": "DAQmx Physical Channel" = "cDAQ1Mod2/ai0"
  "units": i32 = "Deg C"(10143)
  "Temperature Limit": f64 = 30
  "number of samples per channel": i32 = 10
panel indicators:
  "solar panel": waveform<f64>
  "thermocouple": waveform<f64>
  "Limit Exceded?": bool[]
types:
  T1 = cluster{"maximum value": f64, "minimum value": f64}
uses:
  NI::DAQmx::Internal::DAQmx Create Channel (AI-Temperature-Thermocouple).gvi
  NI::DAQmx::Internal::DAQmx Create Channel (AI-Voltage-Basic).gvi
  NI::DAQmx::Internal::DAQmx Timing (Sample Clock).gvi
  NI::DAQmx::Internal::DAQmx Start Task.gvi
  NI::DAQmx::Internal::DAQmx Read (Analog 1D Wfm NChan NSamp).gvi
  NI::DAQmx::Internal::DAQmx Stop Task.gvi
  NI::DAQmx::Internal::DAQmx Clear Task.gvi
  NI::G Core::Error::Display Error.gvi
diagram:
  call "DAQmx Create Channel (AI-Temperature-Thermocouple).gvi"(cjc source="Built-In"(10200), physical channels=$"temperature channels", units=$units, thermocouple type=$"thermocouple type") -> (task out=w1, error out=w2)
  Property Node(instance in=T1 {"maximum value"=5, "minimum value"=-5}, "minimum value"=$"minimum value", "maximum value"=$"maximum value") -> (instance out=w3)
  call "DAQmx Create Channel (AI-Voltage-Basic).gvi"(task in=w1, error in=w2, physical channels=$"voltage channel", measurement range=w3, input terminal configuration=$"Input Terminal Configuration") -> (task out=w4, error out=w5)
  call "DAQmx Timing (Sample Clock).gvi"(task in=w4, error in=w5, rate=$"sample rate", sample mode="Continuous Samples"(10123)) -> (task out=w6, error out=w7)
  call "DAQmx Start Task.gvi"(task in=w6, error in=w7) -> (task out=w8, error out=w9)
  # Channel Settings
  # Acquire Data
  while {
    call "DAQmx Read (Analog 1D Wfm NChan NSamp).gvi"(task in=w8, error in=w9, number of samples per channel=$"number of samples per channel") -> (task out=w10, error out=w11, data=w12)
    Array Index(array=w12) -> (out0[_]=w13, out1[_]=w14)
    Property Node(instance in=w13) -> ("Y"=w15)
    Is Greater(x=w15, y=$"Temperature Limit") -> w16
    $"Limit Exceded?" <- w16
    $thermocouple <- w13
    $"solar panel" <- w14
    Property Node(instance in=w11) -> ("status"=w17, instance out=w18)
    Logical Or(w17, $Stop) -> w19
    stop if w19
  }
  call "DAQmx Stop Task.gvi"(task in=w10, error in=w18) -> (task out=w20, error out=w21)
  call "DAQmx Clear Task.gvi"(task in=w20, error in=w21) -> (error out=w22)
  call "Display Error.gvi"(type of dialog="OK message + warnings", error in=w22)
