vi "Shared Start Trigger.gvi"   [LabVIEW NXG 2.0.0]
panel controls:
  "input rate": f64 = 1000
  "output rate": f64 = 1000
  "samples per channel": i32 = 1000
  "AI channel": "DAQmx Physical Channel" = "cDAQ1Mod8/ai2"
  "AO channel": "DAQmx Physical Channel" = "cDAQ1Mod4/ao2"
panel indicators:
  "signal out": waveform<f64>
  "1st samples": f64[]
uses:
  NI::DAQmx::Internal::DAQmx Create Channel (AI-Voltage-Basic).gvi
  NI::DAQmx::Internal::DAQmx Start Trigger (Digital Edge).gvi
  NI::DAQmx::Internal::DAQmx Timing (Sample Clock).gvi
  NI::DAQmx::Internal::DAQmx Start Task.gvi
  NI::DAQmx::Internal::DAQmx Create Channel (AO-Voltage-Basic).gvi
  NI::Analysis::Generation::Sine Waveform.gvi
  NI::DAQmx::Internal::DAQmx Write (Analog Wfm 1Chan NSamp).gvi
  NI::G Core::Error::Multiplex Errors.gvi
  NI::DAQmx::Internal::DAQmx Read (Analog 1D DBL 1Chan NSamp).gvi
  NI::DAQmx::Internal::DAQmx Clear Task.gvi
  NI::DAQmx::Internal::DAQmx Wait Until Done.gvi
  NI::G Core::Error::Display Error.gvi
diagram:
  call "DAQmx Create Channel (AI-Voltage-Basic).gvi"(physical channels=$"AI channel") -> (task out=w1, error out=w2)
  call "DAQmx Start Trigger (Digital Edge).gvi"(task in=w1, error in=w2, source="/cDAQ1/ao/StartTrigger") -> (task out=w3, error out=w4)
  call "DAQmx Timing (Sample Clock).gvi"(task in=w3, error in=w4, rate=$"input rate", sample mode="Finite Samples"(10178), samples per channel=$"samples per channel") -> (task out=w5, error out=w6)
  call "DAQmx Start Task.gvi"(task in=w5, error in=w6) -> (task out=w7, error out=w8)
  call "DAQmx Create Channel (AO-Voltage-Basic).gvi"(physical channels=$"AO channel") -> (task out=w9, error out=w10)
  call "DAQmx Timing (Sample Clock).gvi"(task in=w9, error in=w10, rate=$"output rate", sample mode="Finite Samples"(10178)) -> (task out=w11, error out=w12)
  call "Sine Waveform.gvi"(amplitude=1, error in=w12) -> (sine wave=w13, error out=w14)
  call "DAQmx Write (Analog Wfm 1Chan NSamp).gvi"(task in=w11, error in=w14, data=w13) -> (task out=w15, error out=w16)
  call "Multiplex Errors.gvi"(error in 1=w8, error in 2=w16) -> (error out=w17)
  call "DAQmx Start Task.gvi"(task in=w15, error in=w17) -> (task out=w18, error out=w19)
  call "DAQmx Read (Analog 1D DBL 1Chan NSamp).gvi"(task in=w7, error in=w19, number of samples per channel=$"samples per channel") -> (task out=w20, error out=w21, data=w22)
  call "DAQmx Clear Task.gvi"(task in=w20) -> (error out=w23)
  call "DAQmx Wait Until Done.gvi"(task in=w18, error in=w21) -> (task out=w24, error out=w25)
  call "DAQmx Clear Task.gvi"(task in=w24, error in=w25) -> (error out=w26)
  Merge Errors(w23, w26) -> (error out=w27)
  call "Display Error.gvi"(error in=w27)
  $"1st samples" <- w22
  $"signal out" <- w13
