vi "Multidevice AO AI Synchronization.gvi"   [LabVIEW NXG 2.0.0]
panel controls:
  "input rate": f64 = 1000
  "output rate": f64 = 1000
  "samples per channel": i32 = 1000
  "AI channel": "DAQmx Physical Channel" = "cDAQ1Mod8/ai2"
  "AO channel": "DAQmx Physical Channel" = "cDAQ1Mod4/ao2"
panel indicators:
  "signal out": waveform<f64>
  "1st samples": waveform<f64>
uses:
  NI::DAQmx::Internal::DAQmx Create Channel (AI-Voltage-Basic).gvi
  NI::DAQmx::Internal::DAQmx Start Trigger (Digital Edge).gvi
  NI::DAQmx::Internal::DAQmx Timing (Sample Clock).gvi
  NI::DAQmx::Internal::DAQmx Start Task.gvi
  NI::DAQmx::Internal::DAQmx Create Channel (AO-Voltage-Basic).gvi
  NI::Analysis::Generation::Sine Waveform.gvi
  NI::DAQmx::Internal::DAQmx Write (Analog Wfm 1Chan NSamp).gvi
  NI::G Core::Error::Multiplex Errors.gvi
  NI::DAQmx::Internal::DAQmx Read (Analog Wfm 1Chan NSamp Duration).gvi
  NI::DAQmx::Internal::DAQmx Clear Task.gvi
  NI::DAQmx::Internal::DAQmx Wait Until Done.gvi
  NI::G Core::Error::Display Error.gvi
diagram:
  call "DAQmx Create Channel (AI-Voltage-Basic).gvi"(physical channels=$"AI channel") -> (task out=w1, error out=w2)
  call "DAQmx Start Trigger (Digital Edge).gvi"(task in=w1, error in=w2, source="/cDAQ1/ao/StartTrigger") -> (task out=w3, error out=w4)
  call "DAQmx Timing (Sample Clock).gvi"(task in=w3, error in=w4, rate=$"input rate", source="/cDAQ1/ao/SampleClock", sample mode="Finite Samples"(10178), samples per channel=$"samples per channel") -> (task out=w5, error out=w6)
  call "DAQmx Start Task.gvi"(task in=w5, error in=w6) -> (task out=w7, error out=w8)
  call "DAQmx Create Channel (AO-Voltage-Basic).gvi"(physical channels=$"AO channel") -> (task out=w9, error out=w10)
  call "DAQmx Start Trigger (Digital Edge).gvi"(task in=w9, error in=w10, source="/cDAQ1/PFI0", edge="Falling"(10171)) -> (task out=w11, error out=w12)
  call "DAQmx Timing (Sample Clock).gvi"(task in=w11, error in=w12, rate=$"output rate", sample mode="Finite Samples"(10178)) -> (task out=w13, error out=w14)
  call "Sine Waveform.gvi"(amplitude=5, error in=w14) -> (sine wave=w15, error out=w16)
  call "DAQmx Write (Analog Wfm 1Chan NSamp).gvi"(task in=w13, error in=w16, data=w15) -> (task out=w17, error out=w18)
  call "Multiplex Errors.gvi"(error in 1=w8, error in 2=w18) -> (error out=w19)
  call "DAQmx Start Task.gvi"(task in=w17, error in=w19) -> (task out=w20, error out=w21)
  call "DAQmx Read (Analog Wfm 1Chan NSamp Duration).gvi"(task in=w7, error in=w21, duration=$"samples per channel") -> (task out=w22, error out=w23, data=w24)
  call "DAQmx Clear Task.gvi"(task in=w22) -> (error out=w25)
  call "DAQmx Wait Until Done.gvi"(task in=w20, error in=w23) -> (task out=w26, error out=w27)
  call "DAQmx Clear Task.gvi"(task in=w26, error in=w27) -> (error out=w28)
  Merge Errors(w25, w28) -> (error out=w29)
  call "Display Error.gvi"(error in=w29)
  $"1st samples" <- w24
  $"signal out" <- w15
