vi "Timebase Synchronization.gvi"   [LabVIEW NXG 2.0.0]
panel controls:
  "physical channel - light sensor": "DAQmx Physical Channel" = "cDAQ1Mod8/ai0"
  "physical channel - thermocouple": "DAQmx Physical Channel" = "cDAQ1Mod2/ai0"
  "sample rate - light sensor": f64 = 1000
  "sample rate - thermocouple": f64 = 1000
  "samples to read - light sensor": i32 = 1000
  "samples to read - thermocouple": i32 = 1000
  "stop button": bool
panel indicators:
  "light sensor data": waveform<f64>
  "thermocouple data": waveform<f64>
uses:
  NI::DAQmx::Internal::DAQmx Create Channel (AI-Temperature-Thermocouple).gvi
  NI::DAQmx::Internal::DAQmx Timing (Sample Clock).gvi
  NI::DAQmx::Internal::DAQmx Start Trigger (Digital Edge).gvi
  NI::DAQmx::Internal::DAQmx Start Task.gvi
  NI::DAQmx::Internal::DAQmx Create Channel (AI-Voltage-Basic).gvi
  NI::DAQmx::Internal::DAQmx Read (Analog Wfm 1Chan NSamp).gvi
  NI::DAQmx::Internal::DAQmx Stop Task.gvi
  NI::DAQmx::Internal::DAQmx Clear Task.gvi
  NI::G Core::Error::Display Error.gvi
diagram:
  call "DAQmx Create Channel (AI-Temperature-Thermocouple).gvi"(physical channels=$"physical channel - thermocouple") -> (task out=w1, error out=w2)
  call "DAQmx Timing (Sample Clock).gvi"(task in=w1, error in=w2, rate=$"sample rate - thermocouple", sample mode="Continuous Samples"(10123)) -> (task out=w3, error out=w4)
  Property Node(instance in=w3, "SampClk_Timebase_Rate_1303"=20000000, "SampClk_Timebase_Src_1308"="/cDAQ1/20MHzTimebase", error in=w4) -> (error out=w5, instance out=w6)
  call "DAQmx Start Trigger (Digital Edge).gvi"(task in=w6, error in=w5, source="/cDAQ1/PFI0", edge="Rising"(10280)) -> (task out=w7, error out=w8)
  call "DAQmx Start Task.gvi"(task in=w7, error in=w8) -> (task out=w9, error out=w10)
  call "DAQmx Create Channel (AI-Voltage-Basic).gvi"(physical channels=$"physical channel - light sensor") -> (task out=w11, error out=w12)
  call "DAQmx Timing (Sample Clock).gvi"(task in=w11, error in=w12, rate=$"sample rate - light sensor", sample mode="Continuous Samples"(10123)) -> (task out=w13, error out=w14)
  Property Node(instance in=w13, "SampClk_Timebase_Rate_1303"=20000000, "SampClk_Timebase_Src_1308"="/cDAQ1/20MHzTimebase", error in=w14) -> (error out=w15, instance out=w16)
  call "DAQmx Start Trigger (Digital Edge).gvi"(task in=w16, error in=w15, source="/cDAQ1/PFI0", edge="Rising"(10280)) -> (task out=w17, error out=w18)
  call "DAQmx Start Task.gvi"(task in=w17, error in=w18) -> (task out=w19, error out=w20)
  s1 = w10  # shift register
  s2 = w9  # shift register
  s3 = w20  # shift register
  s4 = w19  # shift register
  while {
    call "DAQmx Read (Analog Wfm 1Chan NSamp).gvi"(task in=s4, error in=s3, number of samples per channel=$"samples to read - light sensor") -> (task out=w21, error out=w22, data=w23)
    $"light sensor data" <- w23
    call "DAQmx Read (Analog Wfm 1Chan NSamp).gvi"(task in=s2, error in=s1, number of samples per channel=$"samples to read - thermocouple") -> (task out=w24, error out=w25, data=w26)
    $"thermocouple data" <- w26
    Logical Or(w22, w25, $"stop button") -> w27
    next s1 = w25
    next s2 = w24
    next s3 = w22
    next s4 = w21
    stop if w27
  }
  call "DAQmx Stop Task.gvi"(task in=s4, error in=s3) -> (task out=w28, error out=w29)
  call "DAQmx Clear Task.gvi"(task in=w28, error in=w29) -> (error out=w30)
  call "DAQmx Stop Task.gvi"(task in=s2, error in=s1) -> (task out=w31, error out=w32)
  call "DAQmx Clear Task.gvi"(task in=w31, error in=w32) -> (error out=w33)
  Merge Errors(w30, w33) -> (error out=w34)
  call "Display Error.gvi"(error in=w34)
