vi "Read and Log Fan Acceleration-Attributes.gvi"   [LabVIEW NXG 2.0.0]
panel controls:
  "physical channels": "DAQmx Physical Channel" = "cDAQ1Mod7/ai0"
  "input terminal configuration": i32 = "Default"(-1)
  "min voltage": f64 = -5
  "max voltage": f64 = 5
  "sample clock source": "Terminal" = "OnboardClock"
  "sample rate": f64 = 1000
  "number of samples": i32 = 100
  "group name": string = "Balanced Fan"
  "file path": path = path "C:\\Exercises\\DAQ\\Logging Data\\Fan Acceleration.tdms"
  "Boolean": bool
panel indicators:
  "waveform graph": waveform<f64>[]
uses:
  NI::DAQmx::Internal::DAQmx Create Channel (AI-Voltage-Basic).gvi
  NI::DAQmx::Internal::DAQmx Timing (Sample Clock).gvi
  NI::DAQmx::Internal::DAQmx Configure Logging (TDMS).gvi
  NI::DAQmx::Internal::DAQmx Start Task.gvi
  NI::DAQmx::Internal::DAQmx Read (Analog 1D Wfm NChan NSamp).gvi
  NI::DAQmx::Internal::DAQmx Stop Task.gvi
  NI::DAQmx::Internal::DAQmx Clear Task.gvi
  NI::G Core::Error::Display Error.gvi
diagram:
  w1 = $"number of samples"
  Build Cluster($"max voltage", $"min voltage") -> w2
  call "DAQmx Create Channel (AI-Voltage-Basic).gvi"(physical channels=$"physical channels", measurement range=w2, input terminal configuration=$"input terminal configuration") -> (task out=w3, error out=w4)
  call "DAQmx Timing (Sample Clock).gvi"(task in=w3, error in=w4, rate=$"sample rate", source=$"sample clock source", sample mode="Continuous Samples"(10123), samples per channel=w1) -> (task out=w5, error out=w6)
  Property Node(instance in=w5, error in=w6) -> ("AI_Max_17DD"=w7, "AI_Min_17DE"=w8, error out=w9, instance out=w10)
  Build Array(w7, w8) -> w11
  TDMS Open(error in=w9, file path=$"file path", operation="open or create") -> (error out=w12, tdms file out=w13)
  TDMS Set Properties(error in=w12, property names=["Channel Max Voltage", "Channel Min Voltage"], property values=w11, tdms file=w13) -> (error out=w14, tdms file out=w15)
  TDMS Close(error in=w14, tdms file=w15) -> (error out=w16)
  call "DAQmx Configure Logging (TDMS).gvi"(task in=w10, error in=w16, file path=$"file path", group name=$"group name", logging mode="Log and Read"(15842), operation="Open or Create"(15846)) -> (task out=w17, error out=w18)
  call "DAQmx Start Task.gvi"(task in=w17, error in=w18) -> (task out=w19, error out=w20)
  while {
    call "DAQmx Read (Analog 1D Wfm NChan NSamp).gvi"(task in=w19, error in=w20, number of samples per channel=w1) -> (task out=w21, error out=w22, data=w23)
    $"waveform graph" <- w23
    Logical Or(w22, $Boolean) -> w24
    stop if w24
  }
  call "DAQmx Stop Task.gvi"(task in=w21, error in=w22) -> (task out=w25, error out=w26)
  call "DAQmx Clear Task.gvi"(task in=w25, error in=w26) -> (error out=w27)
  call "Display Error.gvi"(error in=w27)
