vi "Read and Log Fan Acceleration.gvi"   [LabVIEW NXG 2.0.0]
panel controls:
  "physical channels": "DAQmx Physical Channel" = "cDAQ1Mod7/ai0"
  "input terminal configuration": i32 = "Default"(-1)
  "min voltage": f64 = -5
  "max voltage": f64 = 5
  "sample clock source": "Terminal" = "OnboardClock"
  "sample rate": f64 = 1000
  "number of samples": i32 = 100
  "group name": string = "Balanced Fan"
  "file path": path = path "C:\\Exercises\\DAQ\\Logging Data\\Fan Acceleration.tdms"
  "Boolean": bool
panel indicators:
  "waveform graph": waveform<f64>[]
uses:
  NI::DAQmx::Internal::DAQmx Create Channel (AI-Voltage-Basic).gvi
  NI::DAQmx::Internal::DAQmx Timing (Sample Clock).gvi
  NI::DAQmx::Internal::DAQmx Configure Logging (TDMS).gvi
  NI::DAQmx::Internal::DAQmx Start Task.gvi
  NI::DAQmx::Internal::DAQmx Read (Analog 1D Wfm NChan NSamp).gvi
  NI::DAQmx::Internal::DAQmx Stop Task.gvi
  NI::DAQmx::Internal::DAQmx Clear Task.gvi
  NI::G Core::Error::Display Error.gvi
diagram:
  w1 = $"number of samples"
  Build Cluster($"max voltage", $"min voltage") -> w2
  call "DAQmx Create Channel (AI-Voltage-Basic).gvi"(physical channels=$"physical channels", measurement range=w2, input terminal configuration=$"input terminal configuration") -> (task out=w3, error out=w4)
  call "DAQmx Timing (Sample Clock).gvi"(task in=w3, error in=w4, rate=$"sample rate", source=$"sample clock source", sample mode="Continuous Samples"(10123), samples per channel=w1) -> (task out=w5, error out=w6)
  call "DAQmx Configure Logging (TDMS).gvi"(task in=w5, error in=w6, file path=$"file path", group name=$"group name", logging mode="Log and Read"(15842), operation="Open or Create"(15846)) -> (task out=w7, error out=w8)
  call "DAQmx Start Task.gvi"(task in=w7, error in=w8) -> (task out=w9, error out=w10)
  while {
    call "DAQmx Read (Analog 1D Wfm NChan NSamp).gvi"(task in=w9, error in=w10, number of samples per channel=w1) -> (task out=w11, error out=w12, data=w13)
    $"waveform graph" <- w13
    Logical Or(w12, $Boolean) -> w14
    stop if w14
  }
  call "DAQmx Stop Task.gvi"(task in=w11, error in=w12) -> (task out=w15, error out=w16)
  call "DAQmx Clear Task.gvi"(task in=w15, error in=w16) -> (error out=w17)
  call "Display Error.gvi"(error in=w17)
